# Grasshopper definition scripts.gh (Grasshopper 1.0.7)

pt = Point([<point referenced from the Rhino model> x334])
panel = Panel("""true
true
true
false
false
false""")
panel_2 = Panel("""true
true
true
true
true
true""")
pt_2 = Point([<point referenced from the Rhino model> x40])
pt_3 = Point([<point referenced from the Rhino model> x15])
nodes = GhPythonScript(pts=pt)  # -> nodes; inputs pts: list of Point3d
# ---------- nodes: Python ----------
from ghpythonlib.componentbase import executingcomponent as component
import Grasshopper, GhPython
import System
import Rhino
import rhinoscriptsyntax as rs
from hashlib import md5

class MyComponent(component):
    
    def RunScript(self, pts):
        """Node objects for StructEngPy.
            Inputs:
                pts: list of point objects
            Output:
                nodes: list of wrapped node objects"""
                        
        __author__ = "Zhuoju Huang"
        __version__ = "2022.07.12"
                        
        import rhinoscriptsyntax as rs
                        
        class Node():
            def __init__(self,name, pt):
                self.name=name
                self.point=pt
                        
        prefix=md5(str(hash(Node)).encode('utf8')).hexdigest()[:6]
        nodes=[Node(prefix+'_'+str(i+1),pt) for i,pt in zip(range(len(pts)),pts)]
                
        
        # return outputs if you have them; here I try it for you:
        return nodes
# ---------- end nodes ----------
nodes_2 = GhPythonScript(pts=pt_2)  # -> nodes; inputs pts: list of Point3d
# ---------- nodes_2: Python ----------
from ghpythonlib.componentbase import executingcomponent as component
import Grasshopper, GhPython
import System
import Rhino
import rhinoscriptsyntax as rs
from hashlib import md5

class MyComponent(component):
    
    def RunScript(self, pts):
        """Provides a scripting component.
            Inputs:
                pts: list of point objects
            Output:
                nodes: list of wrapped node objects"""
                
        __author__ = "Zhuoju Huang"
        __version__ = "2022.07.12"
                
        import rhinoscriptsyntax as rs
                
        class Node():
            def __init__(self,name, pt):
                self.name=name
                self.point=pt
                
        prefix=md5(str(hash(Node)).encode('utf8')).hexdigest()[:6]
        nodes=[Node(prefix+'_'+str(i+1),pt) for i,pt in zip(range(len(pts)),pts)]
        
        # return outputs if you have them; here I try it for you:
        return nodes
# ---------- end nodes_2 ----------
nodes_3 = GhPythonScript(pts=pt_3)  # -> nodes; inputs pts: list of Point3d
# ---------- nodes_3: Python ----------
from ghpythonlib.componentbase import executingcomponent as component
import Grasshopper, GhPython
import System
import Rhino
import rhinoscriptsyntax as rs
from hashlib import md5

class MyComponent(component):
    
    def RunScript(self, pts):
        """Provides a scripting component.
            Inputs:
                pts: list of point objects
            Output:
                nodes: list of wrapped node objects"""
                
        __author__ = "Zhuoju Huang"
        __version__ = "2022.07.12"
                
        import rhinoscriptsyntax as rs
                
        class Node():
            def __init__(self,name, pt):
                self.name=name
                self.point=pt
        prefix=md5(str(hash(Node)).encode('utf8')).hexdigest()[:6]
        nodes=[Node(prefix+'_'+str(i+1),pt) for i,pt in zip(range(len(pts)),pts)]
                
        
        # return outputs if you have them; here I try it for you:
        return nodes
# ---------- end nodes_3 ----------
node_restraints = GhPythonScript(nodes=nodes_3, DOF=panel_2)  # -> node_restraints; inputs nodes: list, DOF: list of Boolean
# ---------- node_restraints: Python ----------
from ghpythonlib.componentbase import executingcomponent as component
import Grasshopper, GhPython
import System
import Rhino
import rhinoscriptsyntax as rs

class MyComponent(component):
    
    def RunScript(self, nodes, DOF):
        """Provides a scripting component.
            Inputs:
                nodes: node objects
                DOF: list of 6 bool represents the degrees of freedom, True if fixed.
            Output:
                node_restraints: The restraint object"""
                        
        __author__ = "Zhuoju Huang"
        __version__ = "2022.07.12"
                        
        import rhinoscriptsyntax as rs
                        
        class NodeRestraint():
            def __init__(self,node, res):
                self.node=node
                self.restraints=res
                        
        node_restraints=[NodeRestraint(node,DOF) for node in nodes]
                        
                
        
        # return outputs if you have them; here I try it for you:
        return node_restraints
# ---------- end node_restraints ----------
node_restraints_2 = GhPythonScript(nodes=nodes_2, DOF=panel_2)  # -> node_restraints; inputs nodes: list, DOF: list of Boolean
# ---------- node_restraints_2: Python ----------
from ghpythonlib.componentbase import executingcomponent as component
import Grasshopper, GhPython
import System
import Rhino
import rhinoscriptsyntax as rs

class MyComponent(component):
    
    def RunScript(self, nodes, DOF):
        """Node restraint objects for StructEngPy.
            Inputs:
                nodes: node objects
                DOF: list of 6 bool represents the degrees of freedom, True if fixed.
            Output:
                node_restraints: The restraint object"""
                        
        __author__ = "Zhuoju Huang"
        __version__ = "2022.07.12"
                        
        import rhinoscriptsyntax as rs
                        
        class NodeRestraint():
            def __init__(self,node, res):
                self.node=node
                self.restraints=res
                        
        node_restraints=[NodeRestraint(node,DOF) for node in nodes]
                        
                
        
        # return outputs if you have them; here I try it for you:
        return node_restraints
# ---------- end node_restraints_2 ----------
node_loads = GhPythonScript(nodes=nodes, f1=0, f2=0, f3="-100e3", m1=0, m2=0, m3=0)  # -> node_loads; inputs nodes: list
# ---------- node_loads: Python ----------
from ghpythonlib.componentbase import executingcomponent as component
import Grasshopper, GhPython
import System
import Rhino
import rhinoscriptsyntax as rs

class MyComponent(component):
    
    def RunScript(self, nodes, f1, f2, f3, m1, m2, m3):
        """Node load objects for StructEngPy.
            Inputs:
                nodes: node objects
                f1: (float) f1 component of nodal force
                f2: (float) f2 component of nodal force
                f3: (float) f3 component of nodal force
                m1: (float) m1 component of nodal force
                m2: (float) m2 component of nodal force
                m3: (float) m3 component of nodal force
            Output:
                node_loads: The load object"""
                                
        __author__ = "Zhuoju Huang"
        __version__ = "2022.07.12"
                                
        import rhinoscriptsyntax as rs
                                
        class NodeLoad():
            def __init__(self,node, f1,f2,f3,m1,m2,m3):
                self.node=node
                self.f1=f1
                self.f2=f2
                self.f3=f3
                self.m1=m1
                self.m2=m2
                self.m3=m3
                                
        node_loads=[NodeLoad(node,f1,f2,f3,m1,m2,m3) for node in nodes]
                                
                        
                
        
        # return outputs if you have them; here I try it for you:
        return node_loads
# ---------- end node_loads ----------
flatten = FlattenTree(Tree=[node_restraints, node_restraints_2], Path="{0}")
beam_section = GhPythonScript(name="sec1", E="2e11", mu="0.2", A="0.0116", I2="8.2e-5", I3="8e-3", J="1.89e-4")  # -> section
# ---------- beam_section: Python ----------
from ghpythonlib.componentbase import executingcomponent as component
import Grasshopper, GhPython
import System
import Rhino
import rhinoscriptsyntax as rs

class MyComponent(component):
    
    def RunScript(self, name, E, mu, A, I2, I3, J):
        """General Section for StructEngPy
            Inputs:
                name: (str) name
                E: (float) Elastic modulus
                mu: (float) Poisson ratio
                A: (float) Cross section area
                I2: (float) moment of inertia around 2 axis
                I3: (float) moment of inertia around 3 axis
                J: (float) Torsion constaint
            Output:
                section: The a output variable"""
        
        __author__ = "Zhuoju Huang"
        __version__ = "2022.07.12"
        
        import rhinoscriptsyntax as rs
        
        class Section():
            def __init__(self,name,E,mu,A,I2,I3,J):
                self.name=name
                self.E=E
                self.mu=mu
                self.A=A
                self.I2=I2
                self.I3=I3
                self.J=J
        
        section=Section(name,E,mu,A,I2,I3,J)
        
        # return outputs if you have them; here I try it for you:
        return section
# ---------- end beam_section ----------
crv = Curve([<curve referenced from the Rhino model> x603])
beams = GhPythonScript(crvs=crv, section=beam_section)  # -> beams; inputs crvs: list of Curve
# ---------- beams: Python ----------
from ghpythonlib.componentbase import executingcomponent as component
import Grasshopper, GhPython
import System
import Rhino
import rhinoscriptsyntax as rs
from hashlib import md5

class MyComponent(component):
    
    def RunScript(self, crvs, section):
        """Beam objects for StructEngPy.
            Inputs:
                crvs: list of crvs to wrapped as beams
                section: beam section object
            Output:
                beams: list of beam objects"""
        
        __author__ = "Zhuoju Huang"
        __version__ = "2022.07.12"
        
        import rhinoscriptsyntax as rs
        
        class Beam():
            def __init__(self,name,crv,section):
                self.name=name
                self.curve=crv
                self.section=section
                
        names=range(len(crvs))
        prefix=md5(str(hash(Beam)).encode('utf8')).hexdigest()[:6]
        beams=[Beam(prefix+'_'+str(name),crv,section) for crv,name in zip(crvs,names)]
        
        # return outputs if you have them; here I try it for you:
        return beams
# ---------- end beams ----------
panel_3 = Panel("C:\Users\Dell\coding\StructEngPy\env\Scripts\python.exe")
button = Button()
button_2 = Button()
assemble = GhPythonScript(
    path="g:\testghsep",
    py_path=panel_3,
    node_loads=node_loads,
    node_restraints=flatten,
    beams=beams,
    tol="5",
    run=Toggle(False))  # -> output; inputs node_loads: list, node_restraints: list, beams: list, run: Boolean
# ---------- assemble: Python ----------
from ghpythonlib.componentbase import executingcomponent as component
import Grasshopper, GhPython
import System
import Rhino
import rhinoscriptsyntax as rs

class MyComponent(component):
    
    def RunScript(self, path, py_path, node_loads, node_restraints, beams, tol, run):
        """Assemble the objects.
            Inputs:
                path: (str) working path.
                py_path: (str) path of python executable.
                node_loads: node load object
                node_restraints: restraints object.
                beams: beams object.
                tol: merge tolerance
                run: (bool) run the script or not.
            Output:
                output: output info"""
                        
        __author__ = "Zhuoju Huang"
        __version__ = "2022.07.12"
                        
        import rhinoscriptsyntax as rs
                        
        import os
        import subprocess
        
        scale=0.001
        
        class Node(object):
            def __init__(self,name, pt):
                self.name=name
                self.point=pt
        
        output="Not yet run."
        
        if run==True:
                        
            vertices=[]
            conn={}
            c=[]
            nodes=[]
            def find_pt(pt,lst,tol=1e-3):
                loc=-1
                for _i in range(len(lst)):
                    if pt.DistanceTo(lst[_i].point)<tol:
                        loc=_i
                        break
                return loc
            
            nodes=[]
            # special nodes first
            for snode in node_restraints+node_loads:
                loc=find_pt(snode.node.point,nodes,tol)
                if loc==-1:
                    nodes.append(snode.node)
                else:
                    snode.node=nodes[loc]
                
        #    # add special node
        #    for node in special_nodes:
        #        loc=find_pt(node.point,nodes)
        #        if loc==-1:
        #            nodes.append(node)
        #        else:
        #            nodes[loc]=node
                                    
            # generate general node
            for b in beams:
                _c=b.curve
                pt1=_c.PointAtStart
                pt2=_c.PointAtEnd
                loc1=find_pt(pt1,nodes,tol)
                loc2=find_pt(pt2,nodes,tol)
                bname=b.name
                conn[bname]=[loc1,loc2]
                if loc1==-1:
                    loc1=len(nodes)
                    node=Node("gen_%d"%loc1,pt1)
                    conn[bname][0]=loc1
                    nodes.append(node)
                if loc2==-1:
                    loc2=len(nodes)
                    node=Node("gen_%d"%loc2,pt2)
                    nodes.append(node)
                    conn[bname][1]=loc2
                            
            # write script
            if not os.path.exists(path):
                os.mkdir(path)
            file=os.path.join(path,"gen_assemble.py")
            with open(file, "w+") as f:
                [f.write("#") for i in range(62)]
                f.write("\n")
                f.write("# This script is generate by Grasshopper app of StructEngPy. #\n")
                [f.write("#") for i in range(62)]
                f.write("\n")
                f.write("from structengpy.core import Api\n")
                f.write("\n")
                f.write("api=Api(r'%s')\n"%path)
                f.write("\n")
                for node in nodes:
                    name=node.name
                    pt=node.point
                    f.write('api.add_node("%s",%f,%f,%f)\n'%(name,pt.X*scale,pt.Y*scale,pt.Z*scale))
                        
                for beam in beams:
                    f.write('api.add_beam("%s","%s","%s",E=%f,mu=%f,A=%f,I3=%f,I2=%f,J=%f,rho=%f)\n'%(
                        beam.name,
                        nodes[conn[beam.name][0]].name,
                        nodes[conn[beam.name][1]].name,
                        beam.section.E,
                        beam.section.mu,
                        beam.section.A,
                        beam.section.I3,
                        beam.section.I2,
                        beam.section.J,
                        7850)
                    )
                    
                f.write('\n')
                f.write('api.add_loadpattern("pat1")'+'\n')
                f.write('api.add_static_case("case1")'+'\n')
                f.write('api.add_case_pattern("case1","pat1",1.0)'+'\n')
                f.write('\n')
                        
                for load in node_loads:
                    name=load.node.name
                    f.write('api.set_nodal_load("pat1","%s",f1=%f,f2=%f,f3=%f,m1=%f,m2=%f,m3=%f)'%(
                        name,
                        load.f1,
                        load.f2,
                        load.f3,
                        load.m1,
                        load.m2,
                        load.m3)+'\n')
                f.write('\n')
                for res in node_restraints:
                    name=res.node.name
                            
                    f.write('api.set_nodal_restraint("case1","%s",%s,%s,%s,%s,%s,%s)'%(name,
                        res.restraints[0],res.restraints[1],res.restraints[2],
                        res.restraints[3],res.restraints[4],res.restraints[5],
                        )+'\n')
                f.write('\n')
                
                f.write('api.assemble()\n')
                f.write('api.save("assembly")\n')
        
            if py_path!=None:
                python=py_path
            else:
                python="python"
            file=os.path.join(path,"gen_assemble.py")
            
            p = subprocess.Popen([python,file],stdin=subprocess.PIPE,stdout=subprocess.PIPE,stderr=subprocess.PIPE,shell=False)
            stdout,stderr = p.communicate()
            output='stdout : '+stdout+'\n'+'stderr : '+stderr
                        
        # return outputs if you have them; here I try it for you:
        return output
# ---------- end assemble ----------
staticsolver = GhPythonScript(path="g:\testghsep", py_path=panel_3, run=Toggle(False))  # -> output; inputs run: Boolean
# ---------- staticsolver: Python ----------
from ghpythonlib.componentbase import executingcomponent as component
import Grasshopper, GhPython
import System
import Rhino
import rhinoscriptsyntax as rs

class MyComponent(component):
    
    def RunScript(self, path, py_path, run):
        """Run static solver.
            Inputs:
                path: (str) working path.
                py_path: (str) python excutable path.
            Output:
                run: (bool) run the component or not"""
                                        
        __author__ = "Zhuoju Huang"
        __version__ = "2022.07.12"
                                        
        import rhinoscriptsyntax as rs
                        
        import os
        import subprocess
        import datetime
        output="Not yet run."
        if run==True:
            file=os.path.join(path,"gen_static.py")
            with open(file, "w+") as f:
                [f.write("#") for i in range(62)]
                f.write("\n")
                f.write("# This script is generate by Grasshopper app of StructEngPy. #\n")
                [f.write("#") for i in range(62)]
                f.write("\n")
                f.write("from structengpy.core import Api\n")
                f.write("\n")
                f.write('api=Api.load(r"%s",r"%s")\n'%(path,"assembly"))
                f.write('api.solve_static("case1")')
                                
            if py_path!=None:
                python=py_path
            else:
                python="python"
                            
            file=os.path.join(path,"gen_static.py")
            p = subprocess.Popen([python,file],stdin=subprocess.PIPE,stdout=subprocess.PIPE,stderr=subprocess.PIPE,shell=False)
            stdout,stderr = p.communicate()
            output='stdout : '+stdout+'\n'+'stderr : '+stderr
                        
        
        # return outputs if you have them; here I try it for you:
        return output
# ---------- end staticsolver ----------
generatevizscripts = GhPythonScript(path="g:\testghsep", py_path=panel_3, run=Toggle(False))  # -> output; inputs run: Boolean
# ---------- generatevizscripts: Python ----------
from ghpythonlib.componentbase import executingcomponent as component
import Grasshopper, GhPython
import System
import Rhino
import rhinoscriptsyntax as rs

class MyComponent(component):
    
    def RunScript(self, path, py_path, run):
        """Generate visualization scripts.
            Inputs:
                path: (str)working path of the model
                py_path: (str)executable python in special env
                run: (bool) run this component.
            Output:
                output: success or not"""
                                
        __author__ = "Zhuoju Huang"
        __version__ = "2022.07.12"
                                
                
        import os
                                
        if run==True:
                        
            if py_path!=None:
                python=py_path
            else:
                python="python"
                
            ## result viewer
            file=os.path.join(path,"result_viz.py")
            with open(file, "w+") as f:
                f.write("""
from structengpy.app.viz.viz_core.viz_core_model import Viewer\n
path=r"%s"
viewer=Viewer(path,"assembly")
viewer.run()
"""%path)
                        
            file=os.path.join(path,"result_viz.bat")
            with open(file, "w+") as f:
                f.write("%s %s"%(python,os.path.join(os.curdir,"result_viz.py")))
        output="success"
        
        # return outputs if you have them; here I try it for you:
        return output
# ---------- end generatevizscripts ----------
panel_4 = Panel(staticsolver)
panel_5 = Panel(assemble)
